# Grasshopper definition Test.gh (Grasshopper 0.9.76)
# Copyright: Ángel Linares García 2014
# plug-ins: GH2SAP

# Abre un archivo vacío de SAP y dale al toggle
set_me_true = BooleanToggle(False)
io = IO(IO=set_me_true, Mode=0, Link=True, Path="F:\GH2SAP\DocumentName.sdb")  # -> Message, Flag
pop2d = Populate2D(Region={Plane=PlaneXY(0, 0, 0), Size=Domain2(u=0..20, v=0..10)}, Count=100, Seed=1)
ptimp = Pt(Point=pop2d, Name="pt", Restraint="000000", Start=io.Flag)
