# Grasshopper definition Test_area.gh (Grasshopper 0.9.76)
# plug-ins: GH2SAP

io = IO(IO=Toggle(False), Mode=0, Link=True, Path="F:\GH2SAP\DocumentName.sdb")  # -> Message, Flag
msphere = MeshSphere(Base=PlaneXY(0, 0, 0), Radius=10, UCount=10, VCount=20)
si = ShellImport(Mesh=msphere, AreaSection="Default", Name="AreaElemt", Start=io.Flag)
