# Grasshopper definition gh2sap_test.gh (Grasshopper 0.9.75)
# Copyright: Ángel Linares García 2014
# plug-ins: GH2SAP

number_slider = Slider(50, range=1..50)
series = Series(Start=0, Step=1, Count=number_slider)  # -> expr("Int(x)", Series)
pop2d = Populate2D(Region={Plane=PlaneXY(0, 0, 0), Size=Domain2(u=0..20, v=0..10)}, Count=number_slider, Seed=Slider(35, range=1..50))
io = GH2SAP_IO(RunSAP=Toggle(True))
rutil = RestraintUtil(U1=False, U2=False, U3=False, R1=False, R2=False, R3=False)
int = Integer(series)
del = DelaunayMesh(Points=pop2d, Plane=PlaneXY(0, 0, 0))
concat = Concatenate(FragmentA="pt_", FragmentB=int)
medges = MeshEdges(Mesh=del)  # -> NakedEdges, InteriorEdges, NonManifoldEdges
line = Line([medges.NakedEdges, medges.InteriorEdges, medges.NonManifoldEdges])
ptimport = Pt_Import(Point=pop2d, Name=concat, Restraint=rutil, Start=io)
lnimp = LnImport(Run=io, Line=line, Names="GH_Frame", Material="Default", Section="Default")
