# Grasshopper definition gh2sap_test_2.gh (Grasshopper 0.9.75)
# Copyright: Ángel Linares García 2014
# plug-ins: GH2SAP

rutil = RestraintUtil(U1=False, U2=False, U3=False, R1=False, R2=False, R3=False)
pop2d = Populate2D(Region={Plane=PlaneXY(0, 0, 0), Size=Domain2(u=0..20, v=0..10)}, Count=Slider(5, range=1..50), Seed=1)
io = GH2SAP_IO(RunSAP=Toggle(False))
del = DelaunayMesh(Points=pop2d, Plane=PlaneXY(0, 0, 0))
ptimport = Pt_Import(Point=pop2d, Name="pt", Restraint=rutil, Start=io)
medges = MeshEdges(Mesh=del)  # -> NakedEdges, InteriorEdges, NonManifoldEdges
line = Line([medges.NakedEdges, medges.InteriorEdges])
lnimp = LnImport(Run=io, Line=line, Names="GH_Frame", Material="Default", Section="Default")
