# Grasshopper definition gh2sap_test_3.gh (Grasshopper 0.9.75)
# Copyright: Ángel Linares García 2014
# plug-ins: GH2SAP

run_sap2000 = BooleanToggle(False)
point_count = Slider(50, range=1..50)
restraint_translation = BooleanToggle(True)
io = GH2SAP_IO(RunSAP=run_sap2000)
pop2d = Populate2D(Region={Plane=PlaneXY(0, 0, 0), Size=Domain2(u=0..20, v=0..10)}, Count=point_count, Seed=1)
rutil = RestraintUtil(U1=restraint_translation, U2=restraint_translation, U3=restraint_translation, R1=False, R2=False, R3=False)
del = DelaunayMesh(Points=pop2d, Plane=PlaneXY(0, 0, 0))
medges = MeshEdges(Mesh=del)  # -> NakedEdges, InteriorEdges, NonManifoldEdges
line = Line([medges.NakedEdges, medges.InteriorEdges, medges.NonManifoldEdges])
ptimport = Pt_Import(Point=pop2d, Name="pt", Restraint=rutil, Start=io)
lnimp = LnImport(Run=io, Line=line, Names="GH_Frame", Material="Default", Section="Default")
